# Grasshopper definition 0909_closestPoints.gh (Grasshopper 1.0.7)
# plug-ins: kdTree, LunchBoxML

populate_3d = Populate3D(Region={Plane=PlaneXY(0, 0, 0), X=Domain(0, 10), Y=Domain(0, 10), Z=Domain(0, 2)}, Count="20000", Seed="2")  # disabled

# ---- group: 5000Points
point = Point([Point(2.935192125, 6.975812124, 1.729973322), Point(9.984474909, 0.9752790681, 1.335978781), Point(9.502893565, 9.570001582, 0.08463421095), Point(0.4306690583, 0.1861684258, 0.3643263468), Point(5.198690316, 2.31026447, 0.9414805039), Point(8.542208694, 5.580628177, 1.860427408)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])

# ---- group: onePoint
point_2 = Point(Point(65.47569258, -62.71102142, 0))

# ---- group: 1000Points
point_3 = Point([<point referenced from the Rhino model> x1000])

# ----
split_list = SplitList(List=point, Index=Slider(1000, range=0..5000))  # -> ListA, ListB

# ---- group: 10000Points
point_4 = Point([Point(2.486685842, 1.107439772, 0.9340213597), Point(8.75821514, 7.961442879, 0.4404517982), Point(0.960044973, 9.516898365, 0.9651758973), Point(9.142282707, 0.9184793154, 1.504984329), Point(4.419897676, 6.225770733, 1.422511779), Point(9.71759215, 4.613409189, 1.807313576)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])

# ---- group: 20000Points
point_5 = Point([Point(7.710938983, 4.041625948, 0.3319973407), Point(0.1120665297, 7.653673407, 0.05748718141), Point(1.286345521, 0.8822897919, 1.782384192), Point(8.352063018, 9.678619327, 1.415326862), Point(5.007372971, 7.748433211, 0.2008566001), Point(5.48319693, 1.131933397, 1.499465603)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])

# ---- group: 15000Points
point_6 = Point([Point(2.486685842, 1.107439772, 0.9340213597), Point(8.75821514, 7.961442879, 0.4404517982), Point(0.960044973, 9.516898365, 0.9651758973), Point(9.142282707, 0.9184793154, 1.504984329), Point(4.419897676, 6.225770733, 1.422511779), Point(9.71759215, 4.613409189, 1.807313576)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])

# ----
closest_point = ClosestPoint(Point=split_list.ListA, Cloud=point_5)  # -> ClosestPoint, CPIndex, Distance
create_rtree = CreateRTree(InputGeometry=point_5)
c_script = CSharpScript(pts=point_5, target=split_list.ListA)  # -> out, A; inputs pts: list of Point3d, target: Point3d; disabled
# ---------- c_script: C# ----------
    double dis = double.MaxValue;
    Point3d best = new Point3d(0, 0, 0);
    foreach(Point3d pt in pts){
      if(pt.DistanceTo(target) < dis){
        dis = pt.DistanceTo(target);
        best = pt;
      }
    }
    A = best;
# ---------- end c_script ----------
point3dlist_closestpoint = CSharpScript(pts=point_5, targetPts=split_list.ListA)  # -> out, A; inputs pts: list of Point3d, targetPts: list of Point3d
# ---------- point3dlist_closestpoint: C# usings ----------
using Rhino.Collections;
# ---------- point3dlist_closestpoint: C# ----------
    
    List<Point3d> nearestPts = new List<Point3d>();
    foreach(Point3d targetPt in targetPts){
      nearestPts.Add(Point3dList.ClosestPointInList(pts, targetPt));
    }
    A = nearestPts;
# ---------- end point3dlist_closestpoint ----------
kd_tree = Kd_Tree(Points=point_5)
findnearest = FindNearest(KdTree=kd_tree, Pts=split_list.ListA)
rtree_closest_point = RTreeClosestPoint(SearchPoints=split_list.ListA, RTree=create_rtree)  # -> ClosestPoint, ClosestIndex
