# Grasshopper definition Explain_Demo.gh (Grasshopper 1.0.7)
# plug-ins: kdTree

number_slider = Slider(0.6, range=0.1..1)

# ---- group: splitList_[)
panel = Panel("""0
1
2
3
4
5
6
7
8""")
c_script = CSharpScript(x=panel)  # -> out, A, B; inputs x: list of Int32
# ---------- c_script: C# usings ----------
using System.Linq;
# ---------- c_script: C# ----------
    A = x.Skip(0).Take(x.Count / 2).ToList();
    B = x.Skip(x.Count / 2 + 1).Take(x.Count - 1).ToList();
# ---------- end c_script ----------
c_script_2 = CSharpScript(x=panel)  # -> out, A, B; inputs x: list of Int32; same code as c_script
panel_2 = Panel(c_script.A)
panel_3 = Panel(c_script.B)

# ---- group: NodeLines
crv = Curve([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])

# ----
pt = ConstructPoint(XCoordinate="14", YCoordinate="9", ZCoordinate=0)
c_script_3 = CSharpScript(x=pt)  # -> out, A; inputs x: Point3d
# ---------- c_script_3: C# ----------
    A = "(" + x.X.ToString() + "," + x.Y.ToString() + ")";
# ---------- end c_script_3 ----------
tag = TextTag3D(Location=pt, Text=c_script_3.A, Size=number_slider, Colour=ColourSwatch(SwatchColor=RGB(9, 5, 247)), Justification=7)

pt_2 = ConstructPoint(XCoordinate="14", YCoordinate="5", ZCoordinate=0)
c_script_4 = CSharpScript(x=pt_2)  # -> out, A; inputs x: Point3d; same code as c_script_3
tag_2 = TextTag3D(Location=pt_2, Text=c_script_4.A, Size=number_slider, Colour=ColourSwatch(SwatchColor=RGB(0, 255, 38)), Justification=7)

pt_3 = ConstructPoint(XCoordinate="11", YCoordinate="10", ZCoordinate=0)
pt_4 = ConstructPoint(XCoordinate="4", YCoordinate="7", ZCoordinate=0)
pt_5 = ConstructPoint(XCoordinate="16", YCoordinate="10", ZCoordinate=0)
pt_6 = ConstructPoint(XCoordinate="7", YCoordinate="13", ZCoordinate=0)
pt_7 = ConstructPoint(XCoordinate="15", YCoordinate="3", ZCoordinate=0)
pt_8 = ConstructPoint(XCoordinate="14", YCoordinate="11", ZCoordinate=0)
pt_9 = ConstructPoint(XCoordinate="9", YCoordinate="4", ZCoordinate=0)
c_script_5 = CSharpScript(x=pt_4)  # -> out, A; inputs x: Point3d; same code as c_script_3
c_script_6 = CSharpScript(x=pt_5)  # -> out, A; inputs x: Point3d; same code as c_script_3
c_script_7 = CSharpScript(x=pt_9)  # -> out, A; inputs x: Point3d; same code as c_script_3
c_script_8 = CSharpScript(x=pt_6)  # -> out, A; inputs x: Point3d; same code as c_script_3
c_script_9 = CSharpScript(x=pt_7)  # -> out, A; inputs x: Point3d; same code as c_script_3
c_script_10 = CSharpScript(x=pt_8)  # -> out, A; inputs x: Point3d; same code as c_script_3
c_script_11 = CSharpScript(x=pt_3)  # -> out, A; inputs x: Point3d; same code as c_script_3
tag_3 = TextTag3D(Location=pt_4, Text=c_script_5.A, Size=number_slider, Justification=7)
tag_4 = TextTag3D(Location=pt_3, Text=c_script_11.A, Size=number_slider, Justification=7)
tag_5 = TextTag3D(Location=pt_5, Text=c_script_6.A, Size=number_slider, Justification=7)
tag_6 = TextTag3D(Location=pt_9, Text=c_script_7.A, Size=number_slider, Justification=7)
tag_7 = TextTag3D(Location=pt_7, Text=c_script_9.A, Size=number_slider, Justification=7)
tag_8 = TextTag3D(Location=pt_8, Text=c_script_10.A, Size=number_slider, Justification=7)
tag_9 = TextTag3D(Location=pt_6, Text=c_script_8.A, Size=number_slider, Justification=7)
merge = Merge(Data1=pt_4, Data2=pt_3, Data3=pt_5, Data4=pt_9, Data5=pt_6, Data6=pt_7, Data7=pt_8)
pt_10 = Point(merge)
kd_tree = Kd_Tree(Points=pt_10)
nns = FindNearest(KdTree=kd_tree, Pts=pt)
